vi "PulsModulate.gvi"   [LabVIEW NXG]
inputs:
  "input bit stream": i8[]
diagram:
  call "MT Generate PSK System Parameters(map).gvi"(PSK type="normal", samples per symbol=16, symbol values=[0, 1, 3, 2], differential PSK="disable") -> (PSK system parameters=w1, error out=w2)
  call "MT Modulate PSK.gvi"(input bit stream=$"input bit stream", PSK system parameters=w1, symbol rate=44100, error in=w2, reset?=TRUE, flush buffers?=FALSE)
